# Grasshopper definition 2_element_working 02.gh (Grasshopper 1.0.7)
# plug-ins: Anemone

# ----
# sender handles
# component 2
# receiver handles
crv = Curve([<curve referenced from the Rhino model> x6])
brep = Brep(<brep referenced from the Rhino model>)
crv_2 = Curve(<curve referenced from the Rhino model>)
crv_3 = Curve(<curve referenced from the Rhino model>)
len = Length(Curve=crv_2)
flip = FlipCurve(Curve=crv)  # -> Curve, Flag
panel = Panel(len)
# sender handles
# receiver handles
# sender handles
# sender handles
# receiver handles
panel_2 = Panel(crv)
python = GhPythonScript(Poly=crv)  # -> out, Plane; inputs Poly: Curve
# ---------- python: Python ----------
__author__ = "Alessio"
__version__ = "2019.09.29"

import rhinoscriptsyntax as rs

def planeFromPolyline(poly=None):
    if poly==None:
        return
    pts = rs.PolylineVertices(poly)
    
    if len(pts) != 3:
        return
    P = rs.PlaneFromPoints(pts[1],pts[0],pts[2])
    return P
    
Plane = planeFromPolyline(Poly)
# ---------- end python ----------
# component 1
# component 2
number_slider = Slider(4, range=0..10)
mesh = Mesh(brep)
mesh_2 = Mesh([<mesh referenced from the Rhino model> x2])
merge = Merge(Data1=mesh, Data2=mesh_2)
python_2 = GhPythonScript(Poly=crv_3)  # -> out, Plane; inputs Poly: Curve; same code as python
group = Group(Objects=brep)
item = ListItem(List=python.Plane, Index=number_slider, Wrap=True)
group_2 = Group(Objects=crv_3)
group_3 = Group(Objects=flip.Curve)
group_4 = Group(Objects=merge)
item_2 = ListItem(List=python_2.Plane, Index=Slider(3, range=0..10), Wrap=True)
merge_2 = Merge(Data1=group, Data2=crv_3)
merge_3 = Merge(Data1=group_4, Data2=crv_2, Data3=group_2, Data4=group_3)
group_5 = Group(Objects=merge_2)
group_6 = Group(Objects=merge_3)

# ----
# with 2 direction element
# 
# and worm
# sender handles
# receiver handles
panel_3 = Panel("""0
1
2
3
4
5
6
7""")
brep_2 = Brep(<brep referenced from the Rhino model>)
type = Curve(<curve referenced from the Rhino model>)
sender = Curve([<curve referenced from the Rhino model> x2])
receiver = Curve([<curve referenced from the Rhino model> x9])
item_3 = ListItem(List=receiver, Index=panel_3, Wrap=True)
flip_2 = FlipCurve(Curve=item_3)  # -> Curve, Flag
replace = ReplaceItems(List=receiver, Item=flip_2.Curve, Indices=panel_3, Wrap=False)  # -> flatten(List)
len_2 = Length(Curve=type)
mesh_3 = Mesh(brep_2)
mesh_4 = Mesh([<mesh referenced from the Rhino model> x3])
group_7 = Group(Objects=brep_2)
panel_4 = Panel(len_2)
merge_4 = Merge(Data1=mesh_3, Data2=mesh_4)  # -> flatten(Result)
python_3 = GhPythonScript(Poly=replace)  # -> out, Plane; inputs Poly: Curve; same code as python
python_4 = GhPythonScript(Poly=sender)  # -> out, Plane; inputs Poly: Curve; same code as python
merge_5 = Merge(Data1=group_7, Data2=sender)
group_8 = Group(Objects=replace)
group_9 = Group(Objects=merge_4)
group_10 = Group(Objects=sender)
item_4 = ListItem(List=python_4.Plane, Index=Slider(1, range=0..10), Wrap=True)
item_5 = ListItem(List=python_3.Plane, Index=Slider(10, range=0..10), Wrap=True)
merge_6 = Merge(Data1=group_9, Data2=type, Data3=group_10, Data4=group_8)

group_11 = Group(Objects=merge_5)
# component 1
group_12 = Group(Objects=merge_6)
grp = Group(group_12)
grp_2 = Group(group_6)
merge_7 = Merge(Data1=group_11, Data2=group_5)
component_type = ValueList({"Component 1": 0, "Component 2": 1}, selected="Component 1")
s_r_combinations_2_on_2 = Panel("""0,0
0,1
0,2
0,3
0,4
0,5""")
s_r_combinations_1_on_1 = Panel("""0,0
0,2
0,3
0,5
0,6
0,7
0,9
1,1
1,0
1,5
1,3
1,7""")
s_r_combinations_1_on_2 = Panel("""0,0
0,1
0,2
0,3
0,4
1,0
1,2
1,5""")
s_r_combinations_2_on_1 = Panel("""0,0
0,2
0,3
0,4
0,5
0,6
0,7""")
filter = StreamFilter(Gate=component_type, Stream0=grp, Stream1=grp_2)
X = UnitX(Factor="4000")
move = Move(Geometry=filter, Motion=X)  # -> Geometry, Transform
entwine = Entwine(
    Branch00=s_r_combinations_1_on_1,
    Branch01=s_r_combinations_1_on_2,
    Branch02=s_r_combinations_2_on_1,
    Branch03=s_r_combinations_2_on_2,
    FlattenInputs=True)  # -> simplify(Result)
n_of_iterations = Slider(500, range=1..5000)
restart = Button()

# ----
# extract s/r planes
# clash detection
# The whole component is oriented so the handles of each one can be used for the next iterations
# removes the member chosen for growth (that is obviously not clashing)
# choose orientation criteria (s/r sequence)
# checks if a slightly smaller version of the new component clashes with the rest of the aggregation
# this parts finds out which type is the receiving component and according to the chosen type for the new component picks from the right combination list
# 0.5 < x < 1 majority of component 1
# x = 0.5 even probability
# 0.0 < x < 0.5 majority of component 2
probability_of_component_1 = Slider(0.5, range=0..1)
panel_5 = Panel("5")
# iterative operation (growth) - with clash detection - random selection - 2 components
loop_start = LoopStart(Repeat=n_of_iterations, Trigger=restart, Data=move.Geometry)  # -> port, Counter, Data; disabled
merge_8 = Merge(Data1=grp, Data2=grp_2)
max_components = Panel("5000")
lng = ListLength(List=loop_start.Data)
random = Random(Range=Domain(0, 1), Number=1, Seed=lng, Integers=False)
larger = LargerThan(FirstNumber=random, SecondNumber=probability_of_component_1)  # -> LargerThan, OrEqualTo
iterations_done = Panel(loop_start.Counter)
item_6 = ListItem(List=merge_8, Index=larger.LargerThan, Wrap=True)
equals = Equality(FirstNumber=loop_start.Counter, SecondNumber=n_of_iterations)  # -> Equality, Inequality
equals_2 = Equality(FirstNumber=lng, SecondNumber=max_components)  # -> Equality, Inequality
ungroup = Ungroup(Group=item_6)
random_2 = Random(Range=lng, Number=1, Seed=loop_start.Counter, Integers=True)
item_7 = ListItem(List=ungroup, Index="1", Wrap=True)
selection = Panel("random object selection")
split = SplitList(List=ungroup, Index="2")  # -> ListA, ListB
components = Panel(lng)
item_8 = ListItem(List=loop_start.Data, Index=random_2, Wrap=True)
len_3 = Length(Curve=item_7)
possible_cases = Panel("""11
12
21
22""")
multiplication = Multiplication(A=len_3, B="10")
ungroup_2 = Ungroup(Group=item_8)
subtraction = Subtraction(A=possible_cases, B="11")
split_2 = SplitList(List=ungroup_2, Index="2")  # -> ListA, ListB
item_9 = ListItem(List=split_2.ListA, Index="1", Wrap=True)
len_4 = Length(Curve=item_9)
addition = Addition(A=multiplication, B=len_4, C="-11")
c_script = CSharpScript(B=addition)  # -> D; inputs B: Int32
# ---------- c_script: C# ----------
    D = Convert.ToInt32(B.ToString(), 2);
# ---------- end c_script ----------
c_script_2 = CSharpScript(B=subtraction)  # -> D; inputs B: Int32; same code as c_script
branch = TreeBranch(Tree=entwine, Path=c_script, MaintainPaths=False)
panel_6 = Panel(c_script_2)
lng_2 = ListLength(List=branch)  # -> expr("x-1", Length)
multiplication_2 = Multiplication(A=loop_start.Counter, B="3")
int = Integer(loop_start.Counter)
random_3 = Random(Range=lng_2, Number=1, Seed=multiplication_2, Integers=True)
or = GateOr(A=equals_2.Equality, B=equals.Equality)
item_10 = ListItem(List=branch, Index=int, Wrap=True)
item_11 = ListItem(List=split_2.ListB, Index="1", Wrap=True)
item_12 = ListItem(List=split.ListB, Index=0, Wrap=True)
split_3 = TextSplit(Text=item_10, Separators=",")
int_2 = Integer(split_3)
ungroup_3 = Ungroup(Group=item_12)
ungroup_4 = Ungroup(Group=item_11)
item_13 = ListItem(List=int_2, Index=0, Wrap=True)  # -> Item, Item1
item_14 = ListItem(List=ungroup_3, Index=item_13.Item, Wrap=True)
item_15 = ListItem(List=ungroup_4, Index=item_13.Item1, Wrap=True)
python_5 = GhPythonScript(Poly=item_15)  # -> out, Plane; inputs Poly: Curve; same code as python
python_6 = GhPythonScript(Poly=item_14)  # -> out, Plane; inputs Poly: Curve; same code as python
orient = Orient(Geometry=item_6, Source=python_6.Plane, Target=python_5.Plane)  # -> Geometry, Transform
cull_i = CullIndex(List=loop_start.Data, Indices=random_2, Wrap=True)
dispatch = Dispatch(List=orient.Geometry, DispatchPattern=or)  # -> ListA, ListB
ungroup_5 = Ungroup(Group=cull_i)
ungroup_6 = Ungroup(Group=orient.Geometry)
mesh_5 = Mesh(<mesh referenced from the Rhino model>)
preview = CustomPreview(Geometry=dispatch.ListB, Material=ColourSwatch(SwatchColor=RGB(255, 255, 255)))
item_16 = ListItem(List=ungroup_6, Index=0, Wrap=True)  # -> flatten(Item)
item_17 = ListItem(List=ungroup_5, Index=0, Wrap=True)  # -> flatten(Item)
deplane = DeconstructPlane(Plane=python_5.Plane)  # -> Origin, XAxis, YAxis, ZAxis
ungroup_7 = Ungroup(Group=item_16)  # -> flatten(Objects)
ungroup_8 = Ungroup(Group=item_17)  # -> flatten(Objects)
amp = Amplitude(Vector=deplane.ZAxis, Amplitude="-0.01")
merge_9 = Merge(Data1=ungroup_8, Data2=mesh_5)
move_2 = Move(Geometry=ungroup_7, Motion=amp)  # -> Geometry, Transform
colom = CollisionOneMany(Collider=ungroup_7, Obstacles=merge_9)  # -> Collision, Index
not = GateNot(A=colom.Collision)
dispatch_2 = Dispatch(List=orient.Geometry, DispatchPattern=not)  # -> ListA, ListB
merge_10 = Merge(Data1=flatten(loop_start.Data), Data2=flatten(dispatch_2.ListA))
loop_end = LoopEnd(
    port=loop_start.port,
    Exit=equals_2.Equality,
    Data=flatten(merge_10),
    TimeOutVal=0,
    pausedState=False,
    state="Constant output")

bool = Boolean(or)
ungroup_9 = Ungroup(Group=loop_end)
lng_3 = ListLength(List=loop_end)
split_4 = SplitList(List=ungroup_9, Index="2")  # -> ListA, ListB
panel_7 = Panel(lng_3)
item_18 = ListItem(List=split_4.ListB, Index=0, Wrap=True)
geo = Geometry(split_4.ListA)
data = Data(merge_7)
ungroup_10 = Ungroup(Group=item_18)
visualize = ValueList({"high-res geometries": 0, "basic mesh geometries": 1}, selected="basic mesh geometries")
dispatch_3 = Dispatch(List=geo, DispatchPattern=bool)  # -> ListA, ListB
item_19 = ListItem(List=ungroup_10, Index=0, Wrap=True)
crv_4 = Curve(ungroup_10)
item_20 = ListItem(List=dispatch_3.ListA, Index=0, Wrap=True)  # -> Item, Item1
python_7 = GhPythonScript(Poly=item_19)  # -> out, Plane; inputs Poly: Curve; same code as python
# visualization while the loop is active
swatch = ColourSwatch(SwatchColor=RGBA(173, 232, 255, 99))
len_5 = Length(Curve=item_20.Item1)
subtraction_2 = Subtraction(A=len_5, B="1")
preview_2 = CustomPreview(Geometry=dispatch_3.ListB, Material=swatch)
filter_2 = StreamFilter(Gate=visualize, Stream0=subtraction_2, Stream1=item_20.Item)
panel_8 = Panel(subtraction_2)
gate = StreamGate(Stream=filter_2, Gate=visualize)  # -> Target0, Target1
ungroup_11 = Ungroup(Group=gate.Target1)
item_21 = ListItem(List=data, Index=gate.Target0, Wrap=True)  # -> simplify(Item)
swatch_2 = ColourSwatch(SwatchColor=RGB(143, 143, 143))
ungroup_12 = Ungroup(Group=item_21)
weave = Weave(Pattern=simplify(subtraction_2), Stream0=ColourSwatch(SwatchColor=RGB(219, 219, 219)), Stream1=swatch_2, NullGaps=False)
item_22 = ListItem(List=ungroup_11, Index="0", Wrap=True)  # -> flatten(Item)
cull_i_2 = CullIndex(List=ungroup_11, Indices="0", Wrap=True)  # -> flatten(List)
item_23 = ListItem(List=ungroup_12, Index=0, Wrap=True)  # -> Item, Item1

# ---- group: joint
mcol = MeshColours(Mesh=graft(cull_i_2), Colours=ColourSwatch(SwatchColor=RGB(250, 60, 60)))  # -> flatten(Mesh)

# ---- group: main geometry
mcol_2 = MeshColours(Mesh=graft(item_22), Colours=weave)  # -> flatten(Mesh)

# ----
python_8 = GhPythonScript(Poly=item_23.Item1)  # -> out, Plane; inputs Poly: Curve; same code as python
mjoin = MeshJoin(Meshes=mcol_2)
orient_2 = Orient(Geometry=simplify(item_23.Item), Source=simplify(python_8.Plane), Target=simplify(python_7.Plane))  # -> Geometry, Transform
panel_9 = Panel(item_22)
mesh_6 = Mesh(mjoin)
ungroup_13 = Ungroup(Group=orient_2.Geometry)
medges = MeshEdges(Mesh=mesh_6)  # -> NakedEdges, InteriorEdges, NonManifoldEdges
edges = BrepEdges(Brep=ungroup_13)  # -> Naked, Interior, NonManifold
crv_5 = Curve([edges.Naked, edges.Interior])
preview_3 = CustomPreview(Geometry=mjoin, Material=swatch_2)
preview_4 = CustomPreview(Geometry=[medges.InteriorEdges, medges.NakedEdges], Material=ColourSwatch(SwatchColor=RGB(0, 0, 0)))
preview_5 = CustomPreview(Geometry=ungroup_13, Material=ColourSwatch(SwatchColor=RGB(173, 232, 255)))
preview_6 = CustomPreview(Geometry=crv_5, Material=ColourSwatch(SwatchColor=RGB(0, 0, 0)))
